% Simulink data dictionary SOC_Stateflow.sldd

Capacity = Simulink.Bus()
  AmS: uint32
  AuS: int32

DenominatorOfIntegratorFactor = Simulink.Parameter(100, StorageClass="Const", DataType="uint8")

SOX_SocType = Simulink.Bus(DataScope="Exported")
  soc: uint32
  tenthAmS: int32
  totalCap: int32

SocDiagCalib_CalibConfigType = Simulink.Bus(DataScope="Imported", HeaderFile="SocDiagCalib.h")
  CapHighCalibAverageVolt: uint16
  CapLowCalibAverageVolt: uint16
  CapLowCalibSoc: uint16
  CapLowCalibDelay: uint16

ParameterM_CalibParaType = Simulink.Bus(DataScope="Imported", HeaderFile="ParameterM.h")
  FWID: int8[16]
  diagnosisPara: Bus: Diagnosis_AllItemParaType
  SocPara: Bus: Soc_CalibConfigType
  SocDiagPara: Bus: SocDiagCalib_CalibConfigType
  ChargePara: Bus: Charge_CalibConfigParaType

Soc_CalibConfigType = Simulink.Bus(DataScope="Imported", HeaderFile="Soc.h")
  ChargeIntegralEfficiency: uint16
  DischargeIntegralEfficiency: uint16

Diagnosis_LevelParaType = Simulink.Bus(DataScope="Imported", HeaderFile="Diagnosis.h")
  triggerThreshold: uint16
  releaseThreshold: uint16
  triggerConfirmTime: uint16
  releaseConfirmTime: uint16

Diagnosis_ParaType = Simulink.Bus(DataScope="Imported", HeaderFile="Diagnosis.h")
  levelPara: Bus: Diagnosis_LevelParaType[4]

Charge_CalibConfigParaType = Simulink.Bus(DataScope="Imported", HeaderFile="Charge_Types.h")
  chargeTotalVoltMax: uint16
  chargeCurrentMax: uint16
  chargeCurrentMin: uint16
  fullChargeRelTotalVolt: uint16

SocDiagPara = bms_rte.ParameterM_CalibParaType(Value=struct(CapHighCalibAverageVolt=0, CapLowCalibAverageVolt=0, CapLowCalibSoc=0, CapLowCalibDelay=0), StorageClass="ParameterM_CurrentCalibParaPtr", DataType="Bus: SocDiagCalib_CalibConfigType")

SocOcvCalib_ConfigType = Simulink.Bus(DataScope="Imported", HeaderFile="SocOcvCalib.h")
  socBuffSize: uint8
  temperatureBuffSize: uint8
  allowedCurrent: uint16
  powerOnDelay: uint16
  calibCycle: uint16
  longCycle: uint16
  checkCycle: uint16
  diffSocMin: uint16
  calibStep: uint16
  linear_calib: boolean

SocOcvCalib_ConfigInfo = mpt.Parameter(struct(
  socBuffSize=0,
  temperatureBuffSize=0,
  allowedCurrent=0,
  powerOnDelay=0,
  calibCycle=0,
  longCycle=0,
  checkCycle=0,
  diffSocMin=0,
  calibStep=0,
  linear_calib=1), StorageClass="ImportFromFile", MemorySection="MemConst", HeaderFile="SocOcvCalib.h", DataType="Bus: SocOcvCalib_ConfigType")

SOC_SOCResolution = Simulink.Parameter(10000, StorageClass="Const", DataType="uint16")
SOC_SOHResolution = Simulink.Parameter(1000, StorageClass="Const", DataType="uint16")

Soc_DchgCumuInfoType = Simulink.Bus(DataScope="Imported", HeaderFile="Soc.h")
  type: Enum: Soc_CumuLativeTypeType
  resoltion: uint16

Soc_ChgCumuInfoType = Simulink.Bus(DataScope="Imported", HeaderFile="Soc.h")
  type: Enum: Soc_CumuLativeTypeType
  resoltion: uint16
  isContainFeedback: uint8

SOC_Timestampms = Simulink.Signal(StorageClass="ImportedExtern", DataType="uint32")
SOC_Current100mA = Simulink.Signal(StorageClass="ImportedExtern", DataType="int16")
SOC_Result = mpt.Signal(StorageClass="ExportedGlobal", DataType="Bus: SOX_SocType")
SOC_DResult = mpt.Signal(StorageClass="ExportedGlobal", DataType="Bus: SOX_SocType")
SocCalibFlag = mpt.Signal(StorageClass="ImportedExtern", DataType="uint8")
SOC_LeftCap = mpt.Signal(StorageClass="ExportedGlobal", DataType="uint32")
SOC_DLeftCap = mpt.Signal(StorageClass="ExportedGlobal", DataType="uint32")
SOC_SohOut = Simulink.Signal(StorageClass="ExportedGlobal", DataType="uint16")
SOC_SocInitFns = Simulink.Signal(StorageClass="ExportedGlobal", DataType="boolean")

SOC_END_CALIB_STATE = enum(DataScope="Exported", DefaultValue="SOC_STATE_CALCNSOC")
  SOC_STATE_CALCNSOC = 0
  SOC_STATE_OCVSOC = 1

SOC_EmptyAus = Simulink.Parameter(0, StorageClass="Const", DataType="int32")
SOC_EfficientHighLimit = Simulink.Parameter(250, StorageClass="Const", DataType="uint8")
SOC_EfficientLowLimit = Simulink.Parameter(40, StorageClass="Const", DataType="uint8")
SOC_OCVTemp_LLimit = Simulink.Parameter(29, StorageClass="Const", DataType="uint8")
SOC_OCVTemp_HLimit = Simulink.Parameter(106, StorageClass="Const", DataType="uint8")
SOC_CapTemp_HLimit = Simulink.Parameter(200, StorageClass="Const", DataType="uint8")
SOC_CapTemp_LLimit = Simulink.Parameter(0, StorageClass="Const", DataType="uint8")
SOC_ClearBufferCmd = Simulink.Signal(StorageClass="ExportedGlobal", DataType="boolean")
SOC_LeftEnergy = Simulink.Signal(StorageClass="ExportedGlobal", DataType="uint16")
SOC_RealSoc = Simulink.Signal(StorageClass="ExportedGlobal")

SOC_ChgCurrentType = Simulink.Bus(DataScope="Exported")
  FstDecreaseCur: uint16
  SndDecreaseCur: uint16
  TrdDecreaseCur: uint16
  LstDecreaseCur: uint16

SOC_LeftCahrgeTime = Simulink.Signal(StorageClass="ExportedGlobal", DataType="uint32")
SOC_CulumChargeAh = Simulink.Signal(StorageClass="ExportedGlobal", DataType="uint32")
SOC_OcvCmd = Simulink.Signal(StorageClass="ExportedGlobal", DataType="boolean")
SOC_CulumDchargeAh = Simulink.Signal(StorageClass="ExportedGlobal", DataType="uint32")
SOC_CalcSOHTempLimit = mpt.Parameter(70, StorageClass="Const", DataType="uint8")
SOHCalibCycle = Simulink.Parameter(10, StorageClass="Const", DataType="uint8")
SOC_SohCalcCapPercent = mpt.Parameter(8, StorageClass="Const", DataType="uint8")

SOC_State = enum(DataScope="Exported", DefaultValue="SOC_STATE_INIT")
  SOC_STATE_INIT = 0
  SOC_STATE_OCV = 1
  SOC_STATE_OCV_LONG = 2
  SOC_STATE_SOH = 3
  SOC_STATE_INTEGRATE = 4
  SOC_STATE_FULL = 5
  SOC_STATE_EMPTY = 6
  SOC_STATE_DCHGSOH = 7

SOC_ChgCalibSocType = Simulink.Bus()
  TempLowLimit: uint8
  TempHighLimit: uint8
  VolLowLimit: uint16
  VolHighLimit: uint16

SOC_ChgSocCalibParam = mpt.Parameter([struct(TempLowLimit=50, TempHighLimit=60, VolLowLimit=4214, VolHighLimit=4280), struct(TempLowLimit=60, TempHighLimit=75, VolLowLimit=4262, VolHighLimit=4286), struct(TempLowLimit=75, TempHighLimit=90, VolLowLimit=4220, VolHighLimit=4280), struct(TempLowLimit=90, TempHighLimit=95, VolLowLimit=4174, VolHighLimit=4280), struct(TempLowLimit=95, TempHighLimit=100, VolLowLimit=4133, VolHighLimit=4200), struct(TempLowLimit=100, TempHighLimit=105, VolLowLimit=4121, VolHighLimit=4256)], StorageClass="Const", DataType="Bus: SOC_ChgCalibSocType")
SOC_LKTSohTable = mpt.Parameter([1000 991 989 992 993 995 994 993 1000 997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 704], StorageClass="Const", DataType="uint16")
SOC_LKTSohCycles = mpt.Parameter([0 1 10 20 30 40 50 60 70 80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 3199], StorageClass="Const", DataType="uint16")
SocOcvCalib_SocBuffer1 = mpt.Parameter([0 500 1000 1500 2000 2500 3000 3500 4000 4500 5000 5500 6000 6500 7000 7500 8000 8500 9000 9500 10000], StorageClass="Const", DataType="uint16")

SOC_ModelConfigType = Simulink.Bus()
  nominalCap: uint32  % 电池额定容量，单位Ams
  lowRealSOC: uint8  % 真实SOC的最小值，精度1%
  highRealSOC: uint8, Max=100  % 真实SOC的最大值,精度为1%
  dchgEndCalib: uint8  % 是否有放电末端校正SOC的策略
  calcSohLKT: uint8  % 查表方式计算SOH
  shortCalibDSOC: uint8  % 短校准是否校正显示SOC（目前延用电咖255策略，短校正时保证目标SOC和显示SOC的差在5%以内）

SOC_NominalCap_AmS = Simulink.Parameter(576000000, StorageClass="Const", DataType="uint32")
SOC_HighRealSoc = Simulink.Parameter(95, StorageClass="Const", DataType="uint8")
SOC_LowRealSoc = Simulink.Parameter(5, StorageClass="Const", DataType="uint8")
SOC_CalcSohLKT = Simulink.Parameter(1, StorageClass="Const", DataType="uint8")
SOC_ShortCalibDSoc = Simulink.Parameter(1, StorageClass="Const", DataType="uint8")
SOC_DchgEndCalib = Simulink.Parameter(0, StorageClass="Const", DataType="uint8")
SOC_CapPerCycle = mpt.Parameter(100, StorageClass="Const", DataType="uint8")
SOC_DSOCJumpMax = mpt.Parameter(500, StorageClass="Const", DataType="uint16")
SOC_SohCalcMidLimit = mpt.Parameter(30, StorageClass="Const", DataType="uint8")
SOC_SohCalcLowLimit = mpt.Parameter(10, StorageClass="Const", DataType="uint8")
SOC_SohCalcHighLimit = mpt.Parameter(60, StorageClass="Const", DataType="uint8")
SOC_NominalVol = mpt.Parameter(4000, StorageClass="Const", DataType="uint16")
SOC_RTCTime = mpt.Signal(StorageClass="ExportedGlobal", DataType="uint32")
SOC_LookUpLeftCap = mpt.Signal(StorageClass="ExportedGlobal", DataType="uint32")
SOC_EnableOcv = mpt.Parameter(1, StorageClass="Const", DataType="uint8")
SOC_DiffVoltMin = mpt.Parameter(10, StorageClass="Const", DataType="uint8")
SocOcvCalib_TempBuffer = mpt.Parameter([40 45 49 54 59 63 68 73 77 82 86 91 96 100 105 110 115 120], StorageClass="Const", DataType="uint8")

SocOcvCalib_VoltageBuffer1 = mpt.Parameter([3300 3310 3320 3330 3340 3350 3360 3370 3380 3390 3400 3410 3420 3430 3440 3450 3460 3470 3480 3490 3500
 3303 3313 3323 3333 3343 3353 3363 3373 3383 3393 3403 3413 3423 3433 3443 3453 3463 3473 3483 3493 3503
 3305 3315 3325 3335 3345 3355 3365 3375 3385 3395 3405 3415 3425 3435 3445 3455 3465 3475 3485 3495 3505
 3307 3317 3327 3337 3347 3357 3367 3377 3387 3397 3407 3417 3427 3437 3447 3457 3467 3477 3487 3497 3507
 3310 3320 3330 3340 3350 3360 3370 3380 3390 3400 3410 3420 3430 3440 3450 3460 3470 3480 3490 3500 3510
 3311 3321 3331 3341 3351 3361 3371 3381 3391 3401 3411 3421 3431 3441 3451 3461 3471 3481 3491 3501 3511
 3313 3323 3333 3343 3353 3363 3373 3383 3393 3403 3413 3423 3433 3443 3453 3463 3473 3483 3493 3503 3513
 3314 3324 3334 3344 3354 3364 3374 3384 3394 3404 3414 3424 3434 3444 3454 3464 3474 3484 3494 3504 3514
 3316 3326 3336 3346 3356 3366 3376 3386 3396 3406 3416 3426 3436 3446 3456 3466 3476 3486 3496 3506 3516
 3317 3327 3337 3347 3357 3367 3377 3387 3397 3407 3417 3427 3437 3447 3457 3467 3477 3487 3497 3507 3517
 3319 3329 3339 3349 3359 3369 3379 3389 3399 3409 3419 3429 3439 3449 3459 3469 3479 3489 3499 3509 3519
 3320 3330 3340 3350 3360 3370 3380 3390 3400 3410 3420 3430 3440 3450 3460 3470 3480 3490 3500 3510 3520
 3322 3332 3342 3352 3362 3372 3382 3392 3402 3412 3422 3432 3442 3452 3462 3472 3482 3492 3502 3512 3522
 3323 3333 3343 3353 3363 3373 3383 3393 3403 3413 3423 3433 3443 3453 3463 3473 3483 3493 3503 3513 3523
 3325 3335 3345 3355 3365 3375 3385 3395 3405 3415 3425 3435 3445 3455 3465 3475 3485 3495 3505 3515 3525
 3322 3332 3342 3352 3362 3372 3382 3392 3402 3412 3422 3432 3442 3452 3462 3472 3482 3492 3502 3512 3522
 3323 3333 3343 3353 3363 3373 3383 3393 3403 3413 3423 3433 3443 3453 3463 3473 3483 3493 3503 3513 3523
 3325 3335 3345 3355 3365 3375 3385 3395 3405 3415 3425 3435 3445 3455 3465 3475 3485 3495 3505 3515 3525], StorageClass="Const", DataType="uint16")

VoidPointer = Simulink.NumericType(DataTypeMode="Double", SignednessBool=true, WordLength=64, FixedExponent=0, DataScope="Imported", HeaderFile="Soc.h")
SOC_EmptyCalibFunction = mpt.Parameter(0, StorageClass="ImportedDefine", HeaderFile="Soc.h", DataType="VoidPointer")

Soc_ConfigInfoType = Simulink.Bus(DataScope="Imported", HeaderFile="Soc.h")
  ChgCumuInfo: Bus: Soc_ChgCumuInfoType
  DchgCumuInfo: Bus: Soc_DchgCumuInfoType
  func: VoidPointer

Soc_ConfigInfo = mpt.Parameter(struct(
  ChgCumuInfo=struct(type=Soc_CumuLativeTypeType.Soc_CumuTypeNone, resoltion=0, isContainFeedback=0),
  DchgCumuInfo=struct(type=Soc_CumuLativeTypeType.Soc_CumuTypeNone, resoltion=0),
  func=0), StorageClass="ImportFromFile", MemorySection="MemConst", DataType="Bus: Soc_ConfigInfoType")

SOC_TempCap_CapBuffer = Simulink.Parameter([837 904 910 972 1028 1058 1056 1057 1058 1059 1060 1061 1062 1063 1064 1065 1066 1067], StorageClass="Const", DataType="uint16")
SOC_TempCap_TempBuffer = Simulink.Parameter(uint8([30 40 50 60 75 90 100 101 102 103 104 105 106 107 108 109 110 111]), StorageClass="Const")
SOC_OcvCalibCmd = Simulink.Signal(StorageClass="ExportedGlobal", DataType="uint8")